# Grasshopper definition JESS.gh (Grasshopper 1.0.7)
# plug-ins: GH_CPython

# How to extract password and login
# better from Eto framework?
eto_forms = Panel("https://developer.rhino3d.com/guides/rhinopython/eto-controls-python/")
eto_form = GhPythonScript(run=Toggle(False))  # -> login, password
# ---------- eto_form: Python ----------
#source code https://developer.rhino3d.com/guides/rhinopython/eto-forms-python/#the-layout

# Imports
import Rhino
import scriptcontext
import System
import Rhino.UI
import Eto.Drawing as drawing
import Eto.Forms as forms

# SampleEtoRoomNumber dialog class
class SampleEtoRoomNumberDialog(forms.Dialog[bool]):

    # Dialog box Class initializer
    def __init__(self):
        # Initialize dialog box
        self.Title = 'ENSIMS/JESS login'
        self.Padding = drawing.Padding(10)
        self.Resizable = False

        # Create controls for the dialog
        self.m_label = forms.Label(Text = 'Enter the login:')
        self.m_textbox = forms.TextBox(Text = None)
        self.p_label = forms.Label(Text = 'Enter the password:')
        self.p_textbox = forms.TextBox(Text = None)

        # Create the default button
        self.DefaultButton = forms.Button(Text = 'OK')
        self.DefaultButton.Click += self.OnOKButtonClick

        # Create the abort button
        self.AbortButton = forms.Button(Text = 'Cancel')
        self.AbortButton.Click += self.OnCloseButtonClick

        # Create a table layout and add all the controls
        layout = forms.DynamicLayout()
        layout.Spacing = drawing.Size(5, 5)
        layout.AddRow(self.m_label, self.m_textbox)
        layout.AddRow(self.p_label, self.p_textbox)
        layout.AddRow(None) # spacer
        layout.AddRow(self.DefaultButton, self.AbortButton)

        # Set the dialog content
        self.Content = layout

    # Start of the class functions
    global data
    # Get the value of the textbox
    def GetText(self):
        data = {"login":self.m_textbox.Text, "password":self.p_textbox.Text}
        return data

    def GetLogin(self):
        return self.m_textbox.Text

    def GetPassword(self):
        return self.p_textbox.Text

    # Close button click handler
    def OnCloseButtonClick(self, sender, e):
        self.m_textbox.Text = ""
        self.Close(False)

    # OK button click handler
    def OnOKButtonClick(self, sender, e):
        if self.m_textbox.Text == "":
            self.Close(False)
        else:
            self.Close(True)

    ## End of Dialog Class ##

# The script that will be using the dialog.
def RequestRoomNumber():
    dialog = SampleEtoRoomNumberDialog();
    rc = dialog.ShowModal(Rhino.UI.RhinoEtoApp.MainWindow)
    global login, password
    login = dialog.GetLogin()
    password = dialog.GetPassword()
    if (rc):
        print dialog.GetText() #Print the Room Number from the dialog control

##########################################################################
# Check to see if this file is being executed as the "main" python
# script instead of being used as a module by some other python script
# This allows us to use the module which ever way we want.
if __name__ == "__main__":
    if run == True:
        RequestRoomNumber()
# ---------- end eto_form ----------
# GH_CPython
ensims_login = EnsimsLogin(login=eto_form.login, password=eto_form.password, cookie="C:/Users/amd/Documents/GitHub/JESS-Grasshopper/cookie.txt")  # -> output, cookie; inputs login: list, password: list, cookie: list
# ---------- ensims_login: Python ----------
# -*- coding: utf-8 -*-
""" 
Python Script
Created on  Sunday September 2020 09:06:17 
@author:  amd 

[desc]
Description of the plugin Here
Write here any thing... 
[/desc]

ARGUMENTS:
----------
<inp> 
    _input :[required] - [type = int] - [default = None] 
    Descripe your input here 
        * bullet point.
        * bullet point
</inp>
<inp>
    Other inputs go here ...
</inp>

RETURN:
----------
    <out>
        output_ : indicate your output description here. \n refers to a new line.
    </out>

"""

import requests, pickle
ApiBase = 'https://api.ensims.com/'
UserApi = ApiBase + 'users/api/'
r = requests.get(UserApi + 'info')

# Set header and body of the POST request
headers = {'Content-Type': 'application/json'}
body = {"email": login, "password": password}
r = requests.post(UserApi + 'auth', headers=headers, json=body)
cookies = r.cookies
output = r.json()

#dump cookies into file
with open(cookie, 'wb') as f:
    pickle.dump(r.cookies, f)
# ---------- end ensims_login ----------
# Native python in Grasshopper uses urllib, urllib2.
# Ironpython is not compatible with "requests" module
panel = Panel(ensims_login.output)
panel_2 = Panel("""('file', ('5ZoneAirCooled-v93.idf', open("C:/Users/amd/Documents/GitHub/JESS-Grasshopper/job_example/5ZoneAirCooled-v93.idf", 'rb'), 'text/plain'))
('file', ('in.epw', open("C:/Users/amd/Documents/GitHub/JESS-Grasshopper/job_example/in.epw", 'rb'), 'text/plain'))
('title', 'Test job')
('desc', 'This is test submission made from python example')
('model', '5ZoneAirCooled-v93.idf')
('split', 'FALSE')
('weather', 'in.epw')""")
eto_form_2 = GhPythonScript(run=Toggle(False))  # -> login, password; same code as eto_form
cookie = Data(ensims_login.cookie)  # disabled
ghpython_script = GhPythonScript()  # -> out, a; unedited script template
jess_login = JESSLogin(login=eto_form_2.login, password=eto_form_2.password, cookie=ensims_login.cookie)  # -> output, JESS_cookie; inputs login: list, password: list, cookie: list; disabled
# ---------- jess_login: Python ----------
# -*- coding: utf-8 -*-
""" 
Python Script
Created on  Sunday September 2020 09:06:17 
@author:  amd 

[desc]
Description of the plugin Here
Write here any thing... 
[/desc]

ARGUMENTS:
----------
<inp> 
    login :[required] - [type = string] - [default = None] 
    Descripe your input here 
        * bullet point.
        * bullet point
</inp>
<inp> 
    password :[required] - [type = string] - [default = None] 
    Descripe your input here 
        * bullet point.
        * bullet point
</inp>
<inp>
    Other inputs go here ...
</inp>

RETURN:
----------
    <out>
        output_ : indicate your output description here. \n refers to a new line.
    </out>

"""
# Use requests (see https://requests.readthedocs.io/en/master/)
import requests, pickle

# API endpoint URL
ApiBase = 'https://api.ensims.com/'
JessApi = ApiBase + 'jess_web/api/'

#Load ENSIMS cookie
r = requests.get(JessApi + 'info')
with open(cookie, 'rb') as f:
    r.cookies.update(pickle.load(f))

# Set header and body of the POST request
headers = {'Content-Type': 'application/json'}
body = {"jessUser": login, "jessPwd": password}
r = requests.post(JessApi + 'session', headers=headers, json=body, cookies=r.cookies)
output = r.json()

#dump cookies into file
import os
JESS_cookie = os.path.dirname(cookie)+'/JESS_cookie.txt'
with open(JESS_cookie, 'wb') as f:
    pickle.dump(r.cookies, f)
# ---------- end jess_login ----------
panel_3 = Panel(jess_login.output)
jess_cookie = Data(jess_login.JESS_cookie)
panel_4 = Panel("C:/Users/amd/Documents/GitHub/JESS-Grasshopper/job_example/Shoebox_v8.9.zip")
cookie_2 = Data(ensims_login.cookie)  # disabled
check_cookie = CheckCookie(cookie=cookie)  # -> output; inputs cookie: list
#   port cookie: [required] - [type = int] - [default = None] Descripe your input here * bullet point. * bullet point
# ---------- check_cookie: Python ----------
# -*- coding: utf-8 -*-
""" 
Python Script
Created on  Sunday September 2020 09:40:26 
@author:  amd 

[desc]
Description of the plugin Here
Write here any thing... 
[/desc]

ARGUMENTS:
----------
<inp> 
    _input :[required] - [type = string] - [default = None] 
    Descripe your input here 
        * bullet point.
        * bullet point
</inp>
<inp>
    Other inputs go here ...
</inp>

RETURN:
----------
    <out>
        output : indicate your output description here. \n refers to a new line.
    </out>

"""

import requests, pickle

# API endpoint URL
ApiBase = 'https://api.ensims.com/'
# ApiBase = 'https://localhost:8443/'
UserApi = ApiBase + 'users/api/'

#Load cookie
r = requests.get(UserApi + 'info')
with open(cookie, 'rb') as f:
    r.cookies.update(pickle.load(f))

#Check-in
r = requests.post(UserApi + 'checkin', cookies=r.cookies)

# Update the copy of the key if successful
if r.json()['ok']:
    cookies = r.cookies

# Show the response
output = r.json()
# ---------- end check_cookie ----------
upload_files = UploadFiles(cookie=cookie, folder="test/0", file="c:/windows/win.ini")  # -> output; inputs cookie: list, folder: list, file: list
# ---------- upload_files: Python ----------
# -*- coding: utf-8 -*-
""" 
Python Script
Created on  Sunday September 2020 10:05:19 
@author:  amd 

[desc]
Description of the plugin Here
Write here any thing... 
[/desc]

ARGUMENTS:
----------
<inp> 
    _input :[required] - [type = int] - [default = None] 
    Descripe your input here 
        * bullet point.
        * bullet point
</inp>
<inp>
    Other inputs go here ...
</inp>

RETURN:
----------
    <out>
        output_ : indicate your output description here. \n refers to a new line.
    </out>

"""
import requests, pickle

# API endpoint URL
ApiBase = 'https://api.ensims.com/'
# ApiBase = 'https://localhost:8443/'
UserApi = ApiBase + 'users/api/'

#Load cookie
r = requests.get(UserApi + 'info')
with open(cookie, 'rb') as f:
    r.cookies.update(pickle.load(f))

# upload a file to a particular folder
files = {'file': open(file, 'rb')}

# POST with files
r = requests.post(UserApi + 'files/' + folder, files=files, cookies=r.cookies)

# Show the returned status
output = r.json()
# ---------- end upload_files ----------
upload_files_2 = UploadFiles(cookie=cookie, folder="test/0", file=panel_4)  # -> output; inputs cookie: list, folder: list, file: list; same code as upload_files
delete_folder = DeleteFolder(cookie=cookie, folder="test")  # -> output; inputs cookie: list, folder: list
# ---------- delete_folder: Python ----------
# -*- coding: utf-8 -*-
""" 
Python Script
Created on  Sunday September 2020 10:05:19 
@author:  amd 

[desc]
Description of the plugin Here
Write here any thing... 
[/desc]

ARGUMENTS:
----------
<inp> 
    _input :[required] - [type = int] - [default = None] 
    Descripe your input here 
        * bullet point.
        * bullet point
</inp>
<inp>
    Other inputs go here ...
</inp>

RETURN:
----------
    <out>
        output_ : indicate your output description here. \n refers to a new line.
    </out>

"""
import requests, pickle

# API endpoint URL
ApiBase = 'https://api.ensims.com/'
# ApiBase = 'https://localhost:8443/'
UserApi = ApiBase + 'users/api/'

#Load cookie
r = requests.get(UserApi + 'info')
with open(cookie, 'rb') as f:
    r.cookies.update(pickle.load(f))

# POST with files
r = requests.delete(UserApi + 'files/' + folder, cookies=r.cookies)

# Show the returned status
output = r.json()
# ---------- end delete_folder ----------
post_job = PostJob(cookie=cookie_2, files=panel_2)  # -> output, job_id; inputs cookie: list, files: list
# ---------- post_job: Python ----------
# -*- coding: utf-8 -*-
""" 
Python Script
Created on  Sunday September 2020 10:05:19 
@author:  amd 

[desc]
Description of the plugin Here
Write here any thing... 
[/desc]

ARGUMENTS:
----------
<inp> 
    _input :[required] - [type = int] - [default = None] 
    Descripe your input here 
        * bullet point.
        * bullet point
</inp>
<inp>
    Other inputs go here ...
</inp>

RETURN:
----------
    <out>
        output_ : indicate your output description here. \n refers to a new line.
    </out>

"""
import requests, pickle

ApiBase = 'https://api.ensims.com/'
JessApi = ApiBase + "jess_web/api/"

#Load cookie
r = requests.get(JessApi + 'info')
with open(cookie, 'rb') as f:
    r.cookies.update(pickle.load(f))

# retrieve a file in a particular folder
r = requests.post(JessApi + 'job', files=files, cookies=r.cookies)

# Show the returned status
output = r.json()
job_id = r.json()['data']
# ---------- end post_job ----------
download_file = DownloadFile(cookie=cookie, file="test/0/win.ini")  # -> output; inputs cookie: list, file: list
# ---------- download_file: Python ----------
# -*- coding: utf-8 -*-
""" 
Python Script
Created on  Sunday September 2020 10:05:19 
@author:  amd 

[desc]
Description of the plugin Here
Write here any thing... 
[/desc]

ARGUMENTS:
----------
<inp> 
    _input :[required] - [type = int] - [default = None] 
    Descripe your input here 
        * bullet point.
        * bullet point
</inp>
<inp>
    Other inputs go here ...
</inp>

RETURN:
----------
    <out>
        output_ : indicate your output description here. \n refers to a new line.
    </out>

"""
import requests, pickle

# API endpoint URL
ApiBase = 'https://api.ensims.com/'
# ApiBase = 'https://localhost:8443/'
UserApi = ApiBase + 'users/api/'

#Load cookie
r = requests.get(UserApi + 'info')
with open(cookie, 'rb') as f:
    r.cookies.update(pickle.load(f))

# retrieve a file in a particular folder
r = requests.get(UserApi + 'files/' + file, cookies=r.cookies)

# Show the contents of the downloaded file
output = r.text
# ---------- end download_file ----------
view_folder = ViewFolder(cookie=cookie, folder="test/0")  # -> output; inputs cookie: list, folder: list
# ---------- view_folder: Python ----------
# -*- coding: utf-8 -*-
""" 
Python Script
Created on  Sunday September 2020 10:05:19 
@author:  amd 

[desc]
Description of the plugin Here
Write here any thing... 
[/desc]

ARGUMENTS:
----------
<inp> 
    _input :[required] - [type = int] - [default = None] 
    Descripe your input here 
        * bullet point.
        * bullet point
</inp>
<inp>
    Other inputs go here ...
</inp>

RETURN:
----------
    <out>
        output_ : indicate your output description here. \n refers to a new line.
    </out>

"""
import requests, pickle

# API endpoint URL
ApiBase = 'https://api.ensims.com/'
# ApiBase = 'https://localhost:8443/'
UserApi = ApiBase + 'users/api/'

#Load cookie
r = requests.get(UserApi + 'info')
with open(cookie, 'rb') as f:
    r.cookies.update(pickle.load(f))

# POST with files
r = requests.get(UserApi + 'files/' + folder, cookies=r.cookies)

# Show the returned status
try: 
    output = r.json()
except:
    output = "No directory called: " + folder
# ---------- end view_folder ----------
panel_5 = Panel(view_folder)
panel_6 = Panel(upload_files_2)
panel_7 = Panel(download_file)
panel_8 = Panel(post_job.output)
panel_9 = Panel(check_cookie)
panel_10 = Panel(upload_files)
panel_11 = Panel(delete_folder)
check_status = CheckStatus(job_id=post_job.job_id, cookie=cookie_2)  # -> output; inputs job_id: list, cookie: list
# ---------- check_status: Python ----------
# -*- coding: utf-8 -*-
""" 
Python Script
Created on  Monday September 2020 12:08:26 
@author:  amd 

[desc]
Description of the plugin Here
Write here any thing... 
[/desc]

ARGUMENTS:
----------
<inp> 
    _input :[required] - [type = int] - [default = None] 
    Descripe your input here 
        * bullet point.
        * bullet point
</inp>
<inp>
    Other inputs go here ...
</inp>

RETURN:
----------
    <out>
        output_ : indicate your output description here. \n refers to a new line.
    </out>

"""
import requests, pickle

#API endpoint URL
ApiBase = 'https://api.ensims.com/'
JessApi = ApiBase + "jess_web/api/"

#Load cookie
r = requests.get(JessApi + 'info')
with open(cookie, 'rb') as f:
    r.cookies.update(pickle.load(f))

# GET job status with job_id
r = requests.get(JessApi + 'job/status/' + str(job_id), cookies=r.cookies)

# Show the returned status
output = r.json()
# ---------- end check_status ----------
# It is not correct json file format
# Issue with GH_CPython
# Where is downloaded file?
panel_12 = Panel(check_status)
